# Dynamo graph Check Toilet Clearance.dyn (Dynamo 2.1.0.7500)

# group: clearance
code_block = CodeBlock { "https://www.dimensions.guide/element/toilet-clearances"; }
minimun_clearance = CodeBlock { 30.5; }
element_w_d_h = CodeBlock { 45.7; 74.3; 210; }
code_block_2 = CodeBlock(clear=minimun_clearance, width=element_w_d_h.out0, depth=element_w_d_h.out1, height=element_w_d_h.out2) { clear; width+clear*2; depth+clear*2; height; }

# group: select
categories = Categories("OST_PlumbingFixtures")
all_elements_of_category = ElementsOfCategory(Category=categories)

# group: solid
get_cs = Python(IN[0]=all_elements_of_category)
# ---------- get_cs.python (21 lines) ----------
import sys
import clr
clr.AddReference('ProtoGeometry')
from Autodesk.DesignScript.Geometry import *

items = UnwrapElement(IN[0]) #IN[0] 
geoms = []

for item in items:
	tr = item.GetTransform()
	originft = Vector.ByCoordinates( tr.Origin.X, tr.Origin.Y, tr.Origin.Z)
	origin = Vector.AsPoint (Vector.Scale(originft, 30.48))
	x = Vector.ByCoordinates( tr.BasisX.X, tr.BasisX.Y, tr.BasisX.Z)
	y = Vector.ByCoordinates( tr.BasisY.X, tr.BasisY.Y, tr.BasisY.Z)
	z =	Vector.ByCoordinates( tr.BasisZ.X, tr.BasisZ.Y, tr.BasisZ.Z)

	geo = CoordinateSystem.ByOriginVectors(origin, x, y, z)
	geoms.append(geo)

# Assign your output to the OUT variable.
OUT = geoms
# ----------------------------------------
byLengths = Cuboid.ByLengths(cs=get_cs, width=code_block_2.out2, length=code_block_2.out1, height=code_block_2.height)
translation_vector = CodeBlock(x=code_block_2.out1, y=code_block_2.out2, z=code_block_2.height) { Vector.ByCoordinates(-x*0.5,y*0.0,z*0.5); }
YAxis = CoordinateSystem.YAxis(coordinateSystem=get_cs)
vector_dot_y = Vector.Dot(vector=translation_vector, vec=YAxis)
XAxis = CoordinateSystem.XAxis(coordinateSystem=get_cs)
vector_dot_x = Vector.Dot(vector=translation_vector, vec=XAxis)
ZAxis = CoordinateSystem.ZAxis(coordinateSystem=get_cs)
vector_dot_z = Vector.Dot(vector=translation_vector, vec=ZAxis)
translate = Geometry.Translate(geometry=byLengths, xTranslation=vector_dot_y, yTranslation=vector_dot_x, zTranslation=vector_dot_z)

# group: intersect
levels = Levels("Level 1")
all_elements_at_level = ElementsAtLevel(Level=levels)
categories_2 = Categories("OST_Walls")
all_elements_of_category_2 = ElementsOfCategory(Category=categories_2)
intersectsSolid = Revit.Element.IntersectsSolid(solids=translate, elements=all_elements_of_category_2)

watch = Watch(get_cs)

# group: Intersection Results
count = List.Count(list=intersectsSolid.Element@L2)
zero = CodeBlock { 0; }
gt = count > zero
filterByBoolMask = List.FilterByBoolMask(list=all_elements_of_category, mask=gt)

# group: Reporting - Comments Parameter
code_block_3 = CodeBlock { "Comments"; }
code_block_4 = CodeBlock(s=count) { s + " Elements in clearance."; }
setParameterByName = Element.SetParameterByName(element=all_elements_of_category, parameterName=code_block_3, value=code_block_4)

# group: Reporting - Clearance Check Parameter
code_block_5 = CodeBlock { "Clearance Check"; }
code_block_6 = CodeBlock { "PASS"; "FAIL"; }
setParameterByName_2 = Element.SetParameterByName(element=filterByBoolMask.in, parameterName=code_block_5, value=code_block_6.out1)
setParameterByName_3 = Element.SetParameterByName(element=filterByBoolMask.out, parameterName=code_block_5, value=code_block_6.out0)

# group: Reporting - Clearance Check Date
list_create = List.Create(item0=setParameterByName_2, item1=setParameterByName_3)
flatten = List.Flatten(list=list_create)
code_block_7 = CodeBlock { "Clearance Check Date"; }
now = DateTime.Now()
setParameterByName_4 = Element.SetParameterByName(element=flatten, parameterName=code_block_7, value=now)  # frozen
